# Grasshopper definition create_brick_stack.gh (Grasshopper 1.0.8)
# plug-ins: RhinoCodePluginGH

# ----
# Create a brick part
part = Python3Script()  # -> out, brick_full, brick_half
# ---------- part: Python ----------
from compas.geometry import Frame
from compas.geometry import Vector
from compas.geometry import Box

from assembly_information_model import Part



# dimensions full brick
width = 0.115
length = 0.240
height = 0.045

# create bricks
tool_frame = Frame([0, 0, 0], [1, 0, 0], [0, -1, 0])
brick_full_geometry = Box(length, width, height, tool_frame, 'box')
brick_full = Part.from_shape(brick_full_geometry, name="brick_full", frame=tool_frame)

brick_half_geometry = Box(length/2, width, height, tool_frame, 'box')
brick_half = Part.from_shape(brick_half_geometry, name="brick_full", frame=tool_frame)
# ---------- end part ----------
show = Python3Script(brick_full=part.brick_full, brick_half=part.brick_half, show=Toggle(False))  # -> out, plane, mesh
# ---------- show: Python ----------
from compas_rhino.conversions import mesh_to_rhino, box_to_rhino, frame_to_rhino


if show:

    #extract the mesh of the part for visulization
    full_mesh = brick_full.mesh
    half_mesh = brick_half.mesh
    #convert to rhino mesh
    mesh = [mesh_to_rhino(full_mesh), mesh_to_rhino(half_mesh)]
    
    #extract the frame of the part for visulization
    full_frame = brick_full.frame
    half_frame = brick_half.frame
    #convert to rhino plane
    plane = [frame_to_rhino(full_frame), frame_to_rhino(half_frame)]
# ---------- end show ----------
geo = Geometry(show.mesh)
pln = Plane(show.plane)

# ----
# Unload Python modules
button = Button()
unload = Python3Script(unload=button)  # -> out, a
# ---------- unload: Python ----------
from compas_rhino import unload_modules

unload_modules('assembly_information_model')
unload_modules('assembly_information_model.assembly')
unload_modules('assembly_information_model.part')
# ---------- end unload ----------

geo_2 = Geometry(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)
geo_3 = Geometry(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)
cp_new = Plane(PlaneXY(-0.6638618097, 0, 0))

# ----
# Generate a brickwall assembly
generate_parts = Python3Script(brick_full=part.brick_full, brick_half=part.brick_half, x=Button())  # -> out, assembly, courses
# ---------- generate_parts: Python ----------
import math

from compas.geometry import Frame, Point, Vector
from compas.geometry import Transformation, Rotation, Translation
from compas.geometry import distance_point_point
from compas_rhino.conversions import plane_to_compas_frame, frame_to_rhino_plane, point_to_compas

from assembly_information_model.assembly import Assembly

#create empty assembly
assembly = Assembly()

qcode = "Q40089"
brick_shape = brick_full.shape
length, width, height = [brick_shape.xsize, brick_shape.ysize, brick_shape.zsize]

courses = 1
rows = 2
columns = 3
gap = 0.03

# total_length = bricks_per_course * length + (bricks_per_course - 1) * mortar_perfends
# gap_even = mortar_perfends
# gap_uneven = (total_length - (bricks_per_course * (length))) / bricks_per_course

# two_bricks = [brick_full.transformed(Translation.from_vector([0, -(width + gap)/2, height/2])), 
#                 brick_full.transformed(Translation.from_vector([0, (width + gap)/2, height/2]))]

# R = Rotation.from_axis_and_angle(Vector.Zaxis(), math.radians(90))
# rotated_two_bricks = [brick.transformed(R) for brick in two_bricks]

# for course in range(courses):
#     dz = course * height #height of brick
#     even_course = True if course % 2 == 0 else False
#     for row in range(rows):
#         dx = row * (length + (1.5*gap)) #row direction
#         for column in range(columns):
#             dy = column * (length + (1.5*gap)) #column direction

#             T = Translation.from_vector([dx, dy, dz])

#             if even_course and (column%2) == (row%2):
#                 brick_list = rotated_two_bricks
#             elif (not even_course) and (column%2) != (row%2):
#                 brick_list = rotated_two_bricks
#             else:
#                 brick_list = two_bricks

#             for brick in brick_list:
#                 new_part = brick.transformed(T)

#                 part = brick_full.copy()
#                 part.frame = new_part.frame
#                 assembly.add_part(part, course=course, built=True, available=True, qcode=qcode)

# Simple stack:

courses = 1
rows = 4
columns = 7
gap_lateral = 0.035
gap_vertical = 0.02
skip_1st_brick = True

for course in range(courses):
    dz = (course * height) + (height / 2) #height of brick
    for row in range(rows):
        dx = - row * (length + gap_vertical) #row direction
        for column in range(columns):
            if not skip_1st_brick:
                dy = column * (width + gap_lateral) #column direction
                T = Translation.from_vector([dx, dy, dz])
                new_part = brick_full.transformed(T)
                part = brick_full.copy()
                part.frame = new_part.frame
                assembly.add_part(part, course=course, built=True, available=True, qcode=qcode)
            else:
                skip_1st_brick = False
# ---------- end generate_parts ----------
add_connections = Python3Script(assembly=generate_parts.assembly, courses=generate_parts.courses)  # -> out, assembly; disabled
# ---------- add_connections: Python ----------
for course in range(courses-1):
    bricks_current_course = [assembly.find_by_key(key) for key in assembly.graph.nodes_where({'course': course})]
    bricks_next_course = [assembly.find_by_key(key) for key in assembly.graph.nodes_where({'course': course + 1})]

    for k in range(len(bricks_current_course)):
        if course % 2 != 0:
            if k == 0:
                assembly.add_connection(bricks_current_course[k],bricks_next_course[k])
            elif k == (len(bricks_current_course)-1):
                assembly.add_connection(bricks_current_course[k],bricks_next_course[k-1])
            else: 
                assembly.add_connection(bricks_current_course[k],bricks_next_course[k-1])
                assembly.add_connection(bricks_current_course[k],bricks_next_course[k])
        else:
            for k in range(len(bricks_current_course)):
                assembly.add_connection(bricks_current_course[k],bricks_next_course[k+1])
                assembly.add_connection(bricks_current_course[k],bricks_next_course[k])
# ---------- end add_connections ----------
transform = Python3Script(assembly=generate_parts.assembly, transform=Button(), center_plane_new=cp_new)  # -> out, assembly
# ---------- transform: Python ----------
from compas.geometry import Frame, Transformation, Rotation, Translation
from compas_rhino.conversions import plane_to_compas_frame

center_frame_new = plane_to_compas_frame(center_plane_new)
# center_frame_new = Frame([-0.4,0.25,0])
center_frame_new = Frame([-0.06,0.03,0])
T = Transformation.from_frame_to_frame(Frame.worldXY(), center_frame_new)

if transform:
    # assembly = assembly.transformed(T)
    parts_keys = [p for p in assembly.part_keys()]
    parts = [assembly.part(p) for p in parts_keys]

    for p in parts:
        p_frame = p.frame.transformed(T)
        p.frame = p_frame
# ---------- end transform ----------

# ----
# Export to JSON
export = Button()
path = Python3Script()  # -> out, DATA
# ---------- path: Python ----------
import os
import getpass

username = getpass.getuser()
USER_FOLDER = os.path.abspath(os.path.join("C:/Users/", username))
DATA = os.path.abspath(os.path.join(USER_FOLDER,"workspace/projects/workshop_iaac_2026/data/assembly"))

print(USER_FOLDER)
print(DATA)
# ---------- end path ----------
export_2 = Python3Script(DATA=path.DATA, assembly=transform.assembly, export=export)  # -> out
# ---------- export_2: Python ----------
import os

if export:
    
    filename = "big_material_stack.json"
    PATH = os.path.join(DATA, filename)
    
    # the assembly has to be serialized such that it can be called from CPython
    assembly.to_json(PATH)
# ---------- end export_2 ----------

reset = Button()
back = Button()
start = Button()
stop = Button()
step = Button()
full = Button()
list = ValueList({"20", "50", "100", "500", "1000", "5000"}, selected="500")
counter = Python3Script(my_assembly=transform.assembly, start=start, stop=stop, step=step, step_back=back, reset=reset, full=full, interval=list)  # -> out, counter
# ---------- counter: Python ----------
from scriptcontext import sticky as st
import Grasshopper

def update_component(ghenv, delay):
    """Schedule an update of the Grasshopper component.

    After the specified delay, the GH component will be automatically updated.

    Parameters
    ----------
    ghenv : :class:`GhPython.Component.PythonEnvironment`
        The current GHPython environment.
    delay : :obj:`int`
        Time in milliseconds until the update is performed.

    Raises
    ------
    ValueError
        If the delay is less than zero.

    """
    if delay <= 0:
        raise ValueError("Delay must be greater than zero")

    ghcomp = ghenv.Component
    ghdoc = ghcomp.OnPingDocument()

    def callback(ghdoc):
        if ghdoc.SolutionState != Grasshopper.Kernel.GH_ProcessStep.Process:
            ghcomp.ExpireSolution(False)

    ghdoc.ScheduleSolution(delay, Grasshopper.Kernel.GH_Document.GH_ScheduleDelegate(callback))

L = range(my_assembly.graph.number_of_nodes())

# store data in component
guid = str(ghenv.Component.InstanceGuid)
counter_key = "counter_" + guid
running_key = "running_" + guid

if counter_key not in st:
    st[counter_key] = 0

if running_key not in st:
    st[running_key] = False
    

if st[running_key]:
    if st[counter_key] < len(L) - 1:
        st[counter_key] += 1
        update_component(ghenv, interval)
    else:
        st[counter_key] = 0
        st[running_key] = False
    
if start:
    st[running_key] = True

if stop:
    st[running_key] = False

if step:
    if st[counter_key] < len(L) - 1:
        st[counter_key] += 1

if step_back:
    if st[counter_key] < len(L) - 1:
        st[counter_key] -= 1

if reset:
    st[counter_key] = 0
    st[running_key] = False

if full:
    st[counter_key] = len(L)-1

if len(L):
    item = L[st[counter_key]]


#st["visualisation_counter"] = st[counter_key]
counter = st[counter_key]+1
# ---------- end counter ----------
panel = Panel(counter.counter)

# ----
# Draw
list_2 = ValueList({"show all": "show_all", "show until key": "show_until_key"}, selected="show all")

visualize = Python3Script(
    assembly=transform.assembly,
    show=list_2,
    highlight_current_part=Toggle(False),
    show_connections=Toggle(True),
    counter=counter.counter)  # -> out, parts_built, parts_not_built, parts_frame, parts_keys, connections, connection_types, current_part_geometry, current_part_frame
# ---------- visualize: Python ----------
from compas_rhino.conversions import mesh_to_rhino, box_to_rhino, frame_to_rhino, line_to_rhino, point_to_rhino
from compas.geometry import Line, Transformation, Point, Vector, Frame, Translation

#print assembly
print(assembly)
#for p in assembly.parts():
#    layer = round(robot.from_RCF_to_BCF(p.frame).point.z/0.08)-1
#    assembly.graph.node_attribute(p.key, "layer", layer)


#get parts datastructure
parts_keys = [p for p in assembly.part_keys()]
parts = [assembly.part(p) for p in parts_keys]
parts_all = []
parts_built = []
parts_not_built = []
parts_frame = []

if show == "show_all":
    for p in parts:
        p_frame = p.frame

        if assembly.graph.node_attribute(p.key, "built"):
            parts_built.append(mesh_to_rhino(p.mesh.transformed(Transformation.from_frame((p_frame)))))
        else:
            parts_not_built.append(mesh_to_rhino(p.mesh.transformed(Transformation.from_frame((p_frame)))))

        parts_frame.append(frame_to_rhino(p_frame))
   
if show == "show_until_key":
    for p in parts[0:counter]:
        p_frame = p.frame
        
        if assembly.graph.node_attribute(p.key, "built"):
            parts_built.append(mesh_to_rhino(p.mesh.transformed(Transformation.from_frame((p_frame)))))
        else:
            parts_not_built.append(mesh_to_rhino(p.mesh.transformed(Transformation.from_frame((p_frame)))))

        parts_frame.append(frame_to_rhino(p_frame))

key = counter

if highlight_current_part:
    current_part = assembly.part(key)
    print(current_part.shape)
    current_part_geometry = mesh_to_rhino(current_part.mesh)
    current_part_frame = frame_to_rhino(current_part.frame)

if show_connections:
    connections = [line_to_rhino(Line(assembly.part(start).frame.point, assembly.part(end).frame.point)) for start, end in assembly.graph.edges()]

    print(connections)
    #connections = [line_to_rhino(Line(assembly.find_by_key(start).frame).point, robot.from_RCF_to_BCF(assembly.find_by_key(end).frame).point) for start, end in assembly.graph.edges()]
    connection_types = [assembly.graph.edge_attribute(t, "type") for t in assembly.graph.edges()]
    #extract points of the frame of the parts for visulization (+ converted to rhino point)
    parts_points = [point_to_rhino(p.frame.point) for p in assembly.parts()]
# ---------- end visualize ----------

panel_2 = Panel(visualize.out)

geo_4 = Geometry(visualize.parts_built)
geo_5 = Geometry(visualize.parts_not_built)
geo_6 = Geometry(visualize.parts_frame)
line = Line(visualize.connections)
pln_2 = Plane(visualize.current_part_frame)
preview = CustomPreview(Geometry=geo_4, Material=ColourSwatch(SwatchColor=RGBA(252, 83, 83, 216)))
preview_2 = CustomPreview(Geometry=geo_5, Material=ColourSwatch(SwatchColor=RGBA(255, 138, 138, 210)))
preview_3 = CustomPreview(Geometry=geo_6, Material=ColourSwatch(SwatchColor=RGB(214, 166, 71)))
py3 = Python3Script(planes=visualize.parts_frame, scale=Slider(0.1, range=0..1))  # -> P, V, C, W; inputs planes: list of Plane, scale: Double
# ---------- py3: Python ----------
from Rhino.Display import ColorRGBA
from ghpythonlib.components import ColourRGBf


red = ColourRGBf(255, 255, 0, 0)
green = ColourRGBf(255, 0, 255, 0)
blue = ColourRGBf(255, 0, 0, 255)

P = []
V = []
C = []

# scale = float(scale)

for plane in planes:
    if not plane:
        continue
    P += [plane.Origin] * 3
    V.append(plane.XAxis * scale)
    V.append(plane.YAxis * scale)
    V.append(plane.ZAxis * scale)
    C += [red, green, blue]

W = 3
# ---------- end py3 ----------
curve_preview = CustomCurvePreview(Curve=line, Linetype="Continuous", Colour=ColourSwatch(SwatchColor=RGB(38, 14, 20)))
tag = TextTag(Location=visualize.parts_frame, Text=visualize.parts_keys)
vdisex = VectorDisplayEx(Point=py3.P, Vector=py3.V, Colour=py3.C, Width=py3.W)
